# Dynamo graph donutChartSample.dyn (Dynamo 1.1.0.2094)

file_path = Filename(".\donutChartData.csv")
fromPath = FileObject(file_path)  # "File.FromPath"
readFromFile = CSV.ReadFromFile(fromPath)
code_block = CodeBlock { 1; }
dropItems = List.DropItems(list=readFromFile, amount=code_block)
transpose = List.Transpose(dropItems)
code_block_2 = CodeBlock(IN=transpose) { names = IN[0]; values = IN[1]; }
data = Charts.DonutChart.Data(code_block_2.names, code_block_2.values)
dataFromCSV = Charts.DonutChart.DataFromCSV(fromPath)
code_block_3 = CodeBlock { DSCore.Color.ByARGB(1,250,180,20); }
number_slider = DoubleSlider(444, range=100..1000 step 1)
number_slider_2 = DoubleSlider(365, range=100..1000 step 1)
boolean = BoolSelector(false)
boolean_2 = BoolSelector(false)
style = Charts.DonutChart.Style(code_block_3, arg2=number_slider, arg3=number_slider_2, arg4=boolean, arg5=boolean_2)
chart = Charts.DonutChart.Chart(dataFromCSV, style)
chart_2 = Charts.DonutChart.Chart(dataFromCSV, style)
chart_3 = Charts.DonutChart.Chart(dataFromCSV, style)
chart_4 = Charts.DonutChart.Chart(dataFromCSV, style)
create_row_container = MandrillRowContainerNode(chart, chart_2, chart_3, chart_4)
create_report = MandrillReportNode(create_row_container)
report_window = MandrillWindowNodeModel(create_report)
pdf_size = pdf_SizeUI("ArchD")
pdf_orientation = pdf_OrientationUI("Landscape")
pdf_fit_mode = pdf_FitModeUI("NoAdjustment")
code_block_4 = CodeBlock { 0; }
PDFStyle = Report.Pdf.PDFStyle(pdf_size, pdf_orientation, pdf_fit_mode, pdf_fit_mode, code_block_4)
file_path_2 = Filename("C:\Users\ksobon\Desktop\donutChart.pdf")
saveAsPDF = Report.Pdf.SaveAsPDF(arg1=PDFStyle, arg2=file_path_2)
